# Grasshopper definition SMS_READ.gh (Grasshopper 0.9.76)
# plug-ins: Python Interpreter, Human, LunchBox, Firefly.Core

toggle = BooleanToggle(True)
layertable = LayerTable(Update=True, AutoUpdate=False)  # -> Layers, FullLayerPaths, LayerColors, Linetypes, MaterialNames, Visible, PrintWidth, PrintColor
timer = Timer(TimerInterval=20, Target=read)
open_port = OpenClosePort(OpenClosePort=Toggle(False), PortNumber="3", BaudRate=115200)
read = SerialReadGeneric(StartReadingValues=Toggle(False), PortNumber="3")  # -> SerialOutput, StatusMessage
write = SerialWriteGeneric(StartWritingValues=Button(), WriteData="N", PortNumber="3")  # -> ArduinoOutput, StatusMessage
panel = Panel(layertable.Layers)
txt = Text(read.SerialOutput)

rec = DataRecorder(read.SerialOutput, DataLimit=-10, RecordData=True)
lng = ListLength(List=rec)
lng_2 = ListLength(List=rec)
subtraction = Subtraction(A=lng, B=1)
subtraction_2 = Subtraction(A=lng_2, B=2)
item = ListItem(List=rec, Index=subtraction, Wrap=True)
item_2 = ListItem(List=rec, Index=subtraction_2, Wrap=True)
python = PythonScript(x=item, y=item_2)  # -> out, a, list
# ---------- python: Python ----------
list = []
if (x != y):
    a = True
    list.append(x)
    print x
# ---------- end python ----------

python_2 = PythonScript(x=read.SerialOutput)  # -> out, a
# ---------- python_2: Python ----------
val = []
val = x.split(' ')

a = val.split(',')
# ---------- end python_2 ----------
split = TextSplit(Text=read.SerialOutput, Separators=" ,")
python_3 = PythonScript(x=txt)  # -> a
# ---------- python_3: Python ----------
import rhinoscriptsyntax as rs

if (x == 'up'):
    a = 1
elif(x=='down'):
    a = -1
else:
    a = 0
# ---------- end python_3 ----------
python_4 = PythonScript(x="1", y=Toggle(True))  # -> out, a
# ---------- python_4: Python ----------
import rhinoscriptsyntax as rs
from scriptcontext import doc
scriptcontext.doc = Rhino.RhinoDoc.ActiveDoc

if (y):
    
    matchingLayers = [layer for layer in doc.Layers if layer.Name == x]
    layerToLock = None
    layerToLock = matchingLayers
    layerToLock.IsLocked = True
    layerToLock.CommitChanges()
# ---------- end python_4 ----------
trim = TextTrim(Text=split, Start=True, End=True)
num = Number(trim)
X = UnitX(Factor=python_3)
rhcom = RhinoCommand(SendCommandToggle=Toggle(False), CommandString="Point ")
rhcom_2 = RhinoCommand(SendCommandToggle=Toggle(False), CommandString="(0,0,0)")
panel_2 = Panel(num)
item_3 = ListItem(List=panel_2, Index=0, Wrap=True)
item_4 = ListItem(List=panel_2, Index=1, Wrap=True)
item_5 = ListItem(List=panel_2, Index=2, Wrap=True)
srf4pt = _4PointSurface(
    CornerA=<geometry referenced from the Rhino model>,
    CornerB=<geometry referenced from the Rhino model>,
    CornerC=<geometry referenced from the Rhino model>,
    CornerD=<geometry referenced from the Rhino model>)
rgb = ColourRGB(Alpha=255, Red=item_3, Green=item_4, Blue=item_5)
move = Move(Geometry=srf4pt, Motion=X)  # -> Geometry, Transform
preview = CustomPreview(Geometry=move.Geometry, Shader=rgb)
